# Grasshopper definition Custom class generation via CustomObject.gh (Grasshopper 1.0.7)
# plug-ins: BH.UI.Grasshopper

# Custom class generation via CustomObject
panel = Panel("SomeCustomType")
pop2d = Populate2D(Region={Plane=PlaneXY(0, 0, 0), Size=Domain2(u=0..20, v=0..10)}, Count=Slider(3, range=0..10), Seed=1)
series = Series(Start=0, Step=1, Count=10)
panel_2 = Panel("http://someOntology.com")
createcustom = CreateCustom(Type=panel, listOfNumbers=series, listOfPoints=pop2d, Component="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")
basicgraphsettings = BasicGraphSettings(
    OntologyTitle="someOntology",
    OntologyDescription="someOntology",
    TBoxURI=panel_2,
    ABoxURI=panel_2,
    SerializeGeoToBase64=Toggle(True),
    Component="{ .BasicGraphSettings")
tottl = ToTTL(Objects=createcustom, GraphSettings=basicgraphsettings, Component="{ .ToTTL")
panel_3 = Panel(tottl)

fromttl = FromTTL(TTLtext=panel_3, Component="{ .FromTTL")  # -> KG, OS
explode = Explode(Object=fromttl.OS, Component="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")  # -> OntologyTitle, OntologyDescription, OntologyBaseAddress, TBoxSettings, ABoxSettings
explode_2 = Explode(Object=fromttl.KG, Component="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")  # -> Type, ListOfNumbers, ListOfPoints, Name, Tags, BHoM_Guid
panel_4 = Panel(explode_2.Type)
panel_5 = Panel(explode.OntologyDescription)
panel_6 = Panel(explode.OntologyTitle)
panel_7 = Panel(explode_2.ListOfNumbers)
panel_8 = Panel(explode_2.ListOfPoints)
