# Grasshopper definition ReadTTL.gh (Grasshopper 1.0.7)
# plug-ins: BH.UI.Grasshopper

panel = Panel("http://someOntology.com")
# Read from TTL
# Create an object, convert it to TTL,
# then read the TTL text and convert it
# back to the original object.
crv = Curve(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)
room = Room(Perimeter=crv, Name="Test room", Component="BH.oM.Architecture.Elements.Room")
basicgraphsettings = BasicGraphSettings(
    OntologyTitle="someOntology",
    OntologyDescription="someOntology",
    TBoxURI=panel,
    ABoxURI=panel,
    SerializeGeoToBase64=Toggle(False),
    Component="{ .BasicGraphSettings")
tottl = ToTTL(Objects=room, GraphSettings=basicgraphsettings, Component="{ .ToTTL")
panel_2 = Panel(tottl)

fromttl = FromTTL(TTLtext=panel_2, Component="{ .FromTTL")  # -> KG, OS
explode = Explode(Object=fromttl.OS, Component="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")  # -> OntologyTitle, OntologyDescription, OntologyBaseAddress, TBoxSettings, ABoxSettings
explode_2 = Explode(Object=fromttl.KG, Component="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")  # -> Perimeter, Location, BHoM_Guid, Name, Fragments, Tags, CustomData
panel_3 = Panel(explode_2.Perimeter)
panel_4 = Panel(explode_2.Name)
panel_5 = Panel(explode.OntologyDescription)
panel_6 = Panel(explode.OntologyTitle)
panel_7 = Panel(explode_2.Location)
